# Grasshopper definition JEPlus.gh (Grasshopper 1.0.7)
# plug-ins: Human, jSwan

panel = Panel("C:\Users\amd\OneDrive - University College London\Modules\14.Building Systems Modelling\TASK 2")
# For more multiple json file tests connect this
boolean_toggle = BooleanToggle(True)
directory_contents = DirectoryContents(FolderPath=panel, Filter="*.json", IncludeSubfolders=boolean_toggle)  # -> FilePaths, FileNames
list_item = ListItem(List=directory_contents.FilePaths, Index=Slider(4, range=0..4), Wrap=True)
panel_2 = Panel(directory_contents.FileNames)
# Specify single location
file_path = FilePath(list_item)
deserialize_json = DeserializeJson(JSON=file_path, OutputsLocked=False)  # -> ProjectType, ProjectID, ProjectNotes, WeatherDir, WeatherFile, Idfdir, Idftemplate, Dckdir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
deserialize_json_2 = DeserializeJson(JSON=deserialize_json.Rvx, OutputsLocked=False)  # -> Notes, Rvis, Csvs, Sqls, Scripts, UserSupplied, Trns, UserVars, Objectives, Constraints
deserialize_json_3 = DeserializeJson(JSON=deserialize_json.ExecSettings, OutputsLocked=False)  # -> NumThreads, WorkDir, SubSet, SampleOpt, RandomSeed, NumberOfJobs, JobListFile, RerunAll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
deserialize_json_4 = DeserializeJson(JSON=deserialize_json.Parameters, OutputsLocked=False)  # -> ParamType, Id, Name, Description, SearchString, Type, ValuesString, SelectedAltValue
deserialize_json_5 = DeserializeJson(JSON=deserialize_json_2.Csvs, OutputsLocked=False)  # -> SourceCsv, FromReport, FromFor, FromTable, FromColumn, FromRow, TableName, ColumnHeaders, UsedInCalc
deserialize_json_6 = DeserializeJson(JSON=deserialize_json_2.UserVars, OutputsLocked=False)  # -> Identifier, Caption, Formula, Report
deserialize_json_7 = DeserializeJson(JSON=deserialize_json_2.Objectives, OutputsLocked=False)  # -> Identifier, Caption, Formula, Scaling, Min, Max, Weight, Enabled
serialize_json = SerializeJson(
    NumThreads=deserialize_json_3.NumThreads,
    WorkDir=deserialize_json_3.WorkDir,
    SubSet=deserialize_json_3.SubSet,
    SampleOpt=deserialize_json_3.SampleOpt,
    RandomSeed=deserialize_json_3.RandomSeed,
    NumberOfJobs=deserialize_json_3.NumberOfJobs,
    JobListFile=deserialize_json_3.JobListFile,
    RerunAll=deserialize_json_3.RerunAll,
    KeepJEPlusFiles=deserialize_json_3.KeepJEPlusFiles,
    KeepEPlusFiles=deserialize_json_3.KeepEPlusFiles,
    DeleteSelectedFiles=deserialize_json_3.DeleteSelectedFiles,
    SelectedFiles=deserialize_json_3.SelectedFiles,
    IncludeNullAndEmptyProperties=False)
serialize_json_2 = SerializeJson(
    ParamType=deserialize_json_4.ParamType,
    Id=deserialize_json_4.Id,
    Name=deserialize_json_4.Name,
    Description=deserialize_json_4.Description,
    SearchString=deserialize_json_4.SearchString,
    Type=deserialize_json_4.Type,
    ValueString=deserialize_json_4.ValuesString,
    SelectedAltValue=deserialize_json_4.SelectedAltValue,
    IncludeNullAndEmptyProperties=False)
serialize_json_3 = SerializeJson(
    SourceCsv=deserialize_json_5.SourceCsv,
    FromReport=deserialize_json_5.FromReport,
    FromFor=deserialize_json_5.FromFor,
    FromTable=deserialize_json_5.FromTable,
    FromColumn=deserialize_json_5.FromColumn,
    FromRow=deserialize_json_5.FromRow,
    TableName=deserialize_json_5.TableName,
    ColumnHeaders=deserialize_json_5.ColumnHeaders,
    UsedInCalc=deserialize_json_5.UsedInCalc,
    IncludeNullAndEmptyProperties=False)
serialize_json_4 = SerializeJson(
    Identifier=deserialize_json_6.Identifier,
    Caption=deserialize_json_6.Caption,
    Formula=deserialize_json_6.Formula,
    Report=deserialize_json_6.Report,
    IncludeNullAndEmptyProperties=False)
serialize_json_5 = SerializeJson(
    Identifier=deserialize_json_7.Identifier,
    Caption=deserialize_json_7.Caption,
    Formula=deserialize_json_7.Formula,
    Scaling=deserialize_json_7.Scaling,
    Min=deserialize_json_7.Min,
    Max=deserialize_json_7.Max,
    Weight=deserialize_json_7.Weight,
    Enabled=deserialize_json_7.Enabled,
    IncludeNullAndEmptyProperties=False)
serialize_json_6 = SerializeJson(
    Notes=deserialize_json_2.Notes,
    Csvs=serialize_json_3,
    UserVars=serialize_json_4,
    Objectives=serialize_json_5,
    IncludeNullAndEmptyProperties=True)
serialize_json_7 = SerializeJson(
    ProjectType=deserialize_json.ProjectType,
    ProjectID=deserialize_json.ProjectID,
    ProjectNotes=deserialize_json.ProjectNotes,
    WeatherDir=deserialize_json.WeatherDir,
    WeatherFile=deserialize_json.WeatherFile,
    Idfdir=deserialize_json.Idfdir,
    Idftemplate=deserialize_json.Idftemplate,
    Dckdir=deserialize_json.Dckdir,
    OutputFileNames=deserialize_json.OutputFileNames,
    Parameters=serialize_json_2,
    Rvx=serialize_json_6,
    ExecSettings=serialize_json,
    IncludeNullAndEmptyProperties=True)

# ----
# JEPlus JSON
serialize_json_8 = SerializeJson(IncludeNullAndEmptyProperties=True)
serialize_json_9 = SerializeJson(IncludeNullAndEmptyProperties=True)
serialize_json_10 = SerializeJson(IncludeNullAndEmptyProperties=True)
serialize_json_11 = SerializeJson(IncludeNullAndEmptyProperties=True)
serialize_json_12 = SerializeJson(IncludeNullAndEmptyProperties=True)
serialize_json_13 = SerializeJson(Csvs=serialize_json_9, UserVars=serialize_json_11, Objectives=serialize_json_10, IncludeNullAndEmptyProperties=True)
serialize_json_14 = SerializeJson(Parameters=serialize_json_12, Rvx=serialize_json_13, ExecSettings=serialize_json_8, IncludeNullAndEmptyProperties=True)
